# Grasshopper definition CustomEA.gh (Grasshopper 0.9.76)
# plug-ins: FUROBOT, RobotKUKA

cmpvel = ComposeVelocity(LineAcc=1, OriAcc=1, EALineV=1000, EAOriV=50)
unit_y = UnitY(Factor=1)
create_material = CreateMaterial(
    Diffuse=ColourSwatch(SwatchColor=RGB(255, 255, 255)),
    Specular=RGB(255, 255, 255),
    Emission=RGB(0, 0, 0),
    Transparency=0,
    Shine=0)
mesh = Mesh(<mesh referenced from the Rhino model>)
mesh_2 = Mesh(<mesh referenced from the Rhino model>)
curve = Curve(<curve referenced from the Rhino model>)
composerobotmesh = ComposeRobotMesh(Geo=mesh_2, Mat=create_material)
dividebysegwithlength = DivideBySegWithLength(Curve=curve, Length=Slider(100, range=0..100), Len=100)
external_axis_compose = ExternalAxisCompose(Point=dividebysegwithlength, E1=Slider(328, range=0..1000), E2=0, E3=0, E4=0)
ceap = ComposeCustomExternalAxisPart(
    RobotMesh=composerobotmesh,
    Vector=Vector(1, 0, 0),
    ValueID=Slider(0, range=0..100),
    ValueLimit=Domain(-10000, 10000),
    IsCoupling=True)
point = Point(<point referenced from the Rhino model>)
create_material_2 = CreateMaterial(
    Diffuse=ColourSwatch(SwatchColor=RGB(255, 255, 255)),
    Specular=RGB(255, 255, 255),
    Emission=RGB(0, 0, 0),
    Transparency=0,
    Shine=0)
composerobotmesh_2 = ComposeRobotMesh(Geo=mesh, Mat=create_material_2)
lightplastictoolhead = LightPlasticToolhead(Index=1)
composeanglecmd = ComposeAngleCmd(
    A1=Slider(13, range=-90..90),
    A2=Slider(-45, range=-90..90),
    A3=Slider(39, range=-90..90),
    A4=0,
    A5=Slider(-36, range=-90..90),
    A6=0)
ptpcmd = PTPCmd(Plane=dividebysegwithlength, EAxis=external_axis_compose, Zone=10, robotState=-2)
xy_plane = XYPlane(Origin=point)
kr10_r900_2 = KR10R9002(Tool=lightplastictoolhead, InitSet="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")
ceap_2 = ComposeCustomExternalAxisPart(
    RobotMesh=composerobotmesh_2,
    Vector=unit_y,
    ValueID=Slider(1, range=0..1),
    ValueLimit=Domain(-10000, 10000),
    IsCoupling=True)
R = KR30_60HA(InitSet="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")
merge = Merge(Data1=composeanglecmd, Data2=ptpcmd)
cctea = ComposeCustomTranslateExternalAxis(Robot=kr10_r900_2, OriginalPlane=xy_plane, EAPart0=ceap, EAPart1=ceap_2)
rc = RobotCore(
    Simulation=Slider(1, range=0..1),
    Command=merge,
    Robot=cctea,
    AutoTCPSwt="True",
    FileSwt="False",
    TrajColorKey="-2732723",
    TrajectorySwt="True")  # -> AllCMDs, Angle, TCP, AllTCPs, Geo, RootPlane, CheckInfo
