# Grasshopper definition CustomTool.gh (Grasshopper 0.9.76)
# plug-ins: FabUnionRobot

lightplastictoolhead = LightPlasticToolhead(Index=1)
curve = Curve(<curve referenced from the Rhino model>)
divide_curve = DivideCurve(Curve=curve, Count=10, Kinks=False)  # -> Points, Tangents, Parameters
getmatrixfromxyzabc = GetMatrixFromXYZABC(
    X=Slider(-3.881, range=-3.881..0),
    Y=Slider(0, range=0..100),
    Z=Slider(411.952, range=0..1000),
    A=Slider(2.015, range=0..10),
    B=Slider(-45.743, range=-45.743..0),
    C=Slider(0, range=0..100))  # -> XYZABC, Matrix
mesh = Mesh(<mesh referenced from the Rhino model>)
movecmd = MoveCmd(Plane=divide_curve.Points, Zone=10, IsLineMode=True)
customtool = CustomTool(ToolMeshModel=mesh, Pose=getmatrixfromxyzabc.XYZABC, Index=1)
kr6r900 = KR6r900()
irb120 = IRB120()
ur10 = UR10()
robotcore = RobotCore(Simulation=Slider(0.73, range=0..1), Command=movecmd, Tool=customtool, Robot=kr6r900, btnFile=True, btnMode=False)  # -> AllCMD, Angle, AllAngles, TCP, AllTCPs, Geo, RootPlane, CheckInfo
