# Grasshopper definition CustomizeRobot.gh (Grasshopper 0.9.76)
# plug-ins: FUROBOT

col = Colour(ColourSwatch(SwatchColor=RGB(255, 98, 0)))
mesh = Mesh(<mesh referenced from the Rhino model>)
crv = Curve(<curve referenced from the Rhino model>)
dbsl = DivideBySegWithLength(Curve=crv, Length=8, Len=8)
composerobotmesh = ComposeRobotMesh(Mesh=mesh, Mat=col)
dom = ConstructDomain(DomainStart=Slider(-90, range=-170..0), DomainEnd=Slider(70, range=0..1000))
dom_2 = ConstructDomain(DomainStart=Slider(-110, range=-360..0), DomainEnd=Slider(110, range=0..1000))
eac = ExternalAxisCompose(Point=dbsl, E1=Slider(289, range=0..1000), E2=0, E3=0, E4=0)
swatch = ColourSwatch(SwatchColor=RGB(66, 66, 66))
mesh_2 = Mesh(<mesh referenced from the Rhino model>)

# ---- group: ABB LOGO
swatch_2 = ColourSwatch(SwatchColor=RGB(0, 0, 0))
mesh_3 = Mesh(<mesh referenced from the Rhino model>)

# ----
mesh_4 = Mesh(<mesh referenced from the Rhino model>)
mesh_5 = Mesh(<mesh referenced from the Rhino model>)
mesh_6 = Mesh(<mesh referenced from the Rhino model>)
mesh_7 = Mesh(<mesh referenced from the Rhino model>)
mesh_8 = Mesh(<mesh referenced from the Rhino model>)
dom_3 = ConstructDomain(DomainStart=Slider(-165, range=-170..0), DomainEnd=Slider(165, range=0..1000))
swatch_3 = ColourSwatch(SwatchColor=RGB(255, 170, 0))
mesh_9 = Mesh(<mesh referenced from the Rhino model>)
dom_4 = ConstructDomain(DomainStart=Slider(-120, range=-360..0), DomainEnd=Slider(120, range=0..1000))
composerobotmesh_2 = ComposeRobotMesh(Mesh=mesh_5, Mat=col)
composerobotmesh_3 = ComposeRobotMesh(Mesh=mesh_7, Mat=ColourSwatch(SwatchColor=RGB(0, 0, 0)))
composerobotmesh_4 = ComposeRobotMesh(Mesh=mesh_4, Mat=col)
mc = MoveCmd(Plane=dbsl, EAxis=eac, Zone=10, IsLineMode=False, robotState=6)
composerobotmesh_5 = ComposeRobotMesh(Mesh=mesh_6, Mat=col)
composerobotmesh_6 = ComposeRobotMesh(Mesh=mesh_8, Mat=col)
composerobotmesh_7 = ComposeRobotMesh(Mesh=mesh_3, Mat=swatch_2)
composerobotmesh_8 = ComposeRobotMesh(Mesh=mesh_2, Mat=col)
dom_5 = ConstructDomain(DomainStart=Slider(-160, range=-360..0), DomainEnd=Slider(160, range=0..1000))
composerobotmesh_9 = ComposeRobotMesh(Mesh=mesh_9, Mat=col)
nickname = LineCmd(Plane=dbsl, EAxis=eac, Zone=10)
dom_6 = ConstructDomain(DomainStart=Slider(-400, range=-400..0), DomainEnd=Slider(400, range=0..1000))
nickname_2 = CustomRobotPart(ValueLimit=Domain(-180, 180), RobotMesh=composerobotmesh_9)
nickname_3 = CustomRobotPart(ValueLimit=dom_3, RobotMesh=composerobotmesh_6)
nickname_4 = CustomRobotPart(ValueLimit=dom_2, RobotMesh=composerobotmesh)
nickname_5 = CustomRobotPart(ValueLimit=dom, RobotMesh=composerobotmesh_5)
nickname_6 = CustomRobotPart(ValueLimit=dom_5, RobotMesh=[composerobotmesh_8, composerobotmesh_7])
nickname_7 = CustomRobotPart(ValueLimit=dom_4, RobotMesh=[composerobotmesh_4, composerobotmesh_2])
nickname_8 = CustomRobotPart(ValueLimit=dom_6, RobotMesh=composerobotmesh_3)
acmd = ComposeAngleCmd(
    A1=Slider(1, range=-180..180),
    A2=Slider(14, range=-180..180),
    A3=Slider(9, range=-180..180),
    A4=0,
    A5=Slider(-40, range=-180..180),
    A6=0)
T = LightPlasticToolhead(Index=1)
nickname_9 = CustomABB2(
    Tool=T,
    R0=nickname_2,
    R1=nickname_3,
    R2=nickname_4,
    R3=nickname_5,
    R4=nickname_6,
    R5=nickname_7,
    R6=nickname_8,
    A="290",
    B="0",
    C="270",
    D="70",
    E="302",
    F="72")
merge = Merge(Data1=acmd, Data2=nickname)  # -> flatten(Result)
rc = RobotCore(
    Simulation=Slider(0, range=0..1),
    Command=merge,
    Robot=nickname_9,
    AutoTCPSwt="True",
    FileSwt="False",
    TrajColorKey="-8355712",
    TrajectorySwt="False")  # -> AllCMDs, Angle, TCP, AllTCPs, Geo, RootPlane, CheckInfo
