# Grasshopper definition ExternalAxis.gh (Grasshopper 0.9.76)
# plug-ins: FabUnionRobot

point = Point(<point referenced from the Rhino model>)
point_2 = Point(<point referenced from the Rhino model>)
line = Line(StartPoint=point, EndPoint=point_2)
divide_curve = DivideCurve(Curve=line, Count=10, Kinks=False)  # -> Points, Tangents, Parameters
point_3 = Point(divide_curve.Points)
list_length = ListLength(List=point_3)
construct_domain = ConstructDomain(DomainStart=0, DomainEnd=Slider(2700, range=0..10000))
subtraction = Subtraction(A=list_length, B=Slider(1, range=0..1))
range = Range(Domain=construct_domain, Steps=subtraction)
external_axis_compose = ExternalAxisCompose(Point=point_3, E1=range, E2=0, E3=0, E4=0)
lightplastictoolhead = LightPlasticToolhead(Index=1)
movecmd = MoveCmd(Plane=divide_curve.Points, EAxis=external_axis_compose, Zone=10, IsLineMode=True)
kr20r1810 = KR20r1810()
tjlabsingleaxis = TJLabSingleAxis()
robotcore = RobotCore(
    Simulation=Slider(0, range=0..1),
    Command=movecmd,
    Tool=lightplastictoolhead,
    Robot=kr20r1810,
    EA=tjlabsingleaxis,
    btnFile=True,
    btnMode=False)  # -> AllCMD, Angle, AllAngles, TCP, AllTCPs, Geo, RootPlane, CheckInfo
