# Grasshopper definition GettingStarted.gh (Grasshopper 0.9.76)
# plug-ins: FabUnionRobot

curve = Curve(<curve referenced from the Rhino model>)
divide_curve = DivideCurve(Curve=curve, Count=10, Kinks=False)  # -> Points, Tangents, Parameters
lightplastictoolhead = LightPlasticToolhead(Index=1)
movecmd = MoveCmd(Plane=divide_curve.Points, Zone=10, IsLineMode=True)
kr6r900 = KR6r900()
robotcore = RobotCore(Simulation=Slider(0, range=0..1), Command=movecmd, Tool=lightplastictoolhead, Robot=kr6r900, btnFile=True, btnMode=False)  # -> AllCMD, Angle, AllAngles, TCP, AllTCPs, Geo, RootPlane, CheckInfo
